# Grasshopper definition toon_shader.gh (Grasshopper 1.0.7)
# plug-ins: ghgl, Yellow

mesh = Mesh(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)
range = Range(Domain=Domain(0, 1), Steps=Slider(35, range=0..100))
pt = ConstructPoint(XCoordinate=0, YCoordinate=0, ZCoordinate=0)
contour = Contour(Shape=mesh, Point=Point(0, 0, 0), Direction=Vector(0, 0, 1), Distance=Slider(10, range=0..10))
multiplication = Multiplication(A=range, B=Slider(768, range=0..1000))
multiplication_2 = Multiplication(A=range, B=Slider(88.9, range=0..100))
multiplication_3 = Multiplication(A=range, B=Slider(51, range=0..100))
X = UnitX(Factor=multiplication_2)
Z = UnitZ(Factor=multiplication)
pi = Pi(Factor=multiplication_3)
move = Move(Geometry=pt, Motion=X)  # -> Geometry, Transform
move_2 = Move(Geometry=move.Geometry, Motion=Z)  # -> Geometry, Transform
mpipe = MeshPipe(Curve=contour, Radius=Slider(6, range=0..10), Segments=Slider(15, range=0..100), Accuracy=1, CapType=3, Faceted=True)
rotate = Rotate(Geometry=move_2.Geometry, Angle=pi, Plane=PlaneXY(0, 0, 0))  # -> Geometry, Transform
number_slider = Slider(8.7, range=0..10)
gl_mesh = GLMeshShader(
    M=mpipe,
    Div=Slider(1, range=0..10),
    Thickness=Slider(0.31, range=0..1),
    Ambient=Slider(0.44, range=0..1),
    Col=ColourSwatch(SwatchColor=RGB(255, 242, 0)),
    DepthTestingEnabled=True,
    DepthWritingEnabled=True,
    DrawMode=4,
    FragmentShader="""#version 330

uniform vec3 _lightDirection[4];
uniform mat3 _worldToCameraNormal;

uniform float div;
uniform vec4 col;
uniform float thickness;
uniform float ambient;

in  vec3 normal;
in vec3 camera_dir;
out vec4 fragment_color;

void main() {
  vec3 l = normalize(_lightDirection[0]);
  vec3 camNormal = _worldToCameraNormal * normal;
  float intensity = dot(l, normalize(camNormal.xyz));
  vec4 diffuse = col;

  vec3 ambientcol = vec3(ambient, ambient, ambient) * diffuse.rgb;
  
  float dif = round(abs(intensity) * div) / div;
  vec3 col = mix(ambientcol, diffuse.xyz, dif);
  
  float dotval = abs(dot(normal, camera_dir));
  dotval = step(thickness, dotval);
  
  col = col * dotval;
  
  fragment_color = vec4(col, diffuse.a);
}""",
    GLShader=(0, 2, 0),
    PreviewSortOrder=5,
    VertexShader="""#version 330

layout(location = 0) in vec3 _meshVertex;
layout(location = 1) in vec3 _meshNormal;

uniform mat4 _worldToClip;
uniform vec3 _cameraLocation;
out vec3 normal;
out vec3 camera_dir;

void main() {
  normal = _meshNormal;
  camera_dir = normalize(_meshVertex - _cameraLocation);
  gl_Position = _worldToClip * vec4(_meshVertex , 1.0);
}""",
    glLineWidth=3,
    glPointSize=8)  # -> Color, Depth
intcrv = Interpolate(Vertices=rotate.Geometry, Degree=3, Periodic=False, KnotStyle=1)  # -> Curve, Length, Domain
pipe = Pipe(Curve=intcrv.Curve, Radius=Slider(30, range=0..100), Caps=2)
Y = UnitY(Factor=Slider(486, range=0..1000))
move_3 = Move(Geometry=pipe, Motion=Y)  # -> Geometry, Transform
gl_mesh_2 = GLMeshShader(
    M=move_3.Geometry,
    Div=Slider(4, range=0..10),
    Thickness=Slider(0.33, range=0..1),
    Ambient=Slider(0.44, range=0..1),
    Col=ColourSwatch(SwatchColor=RGB(255, 220, 66)),
    DepthTestingEnabled=True,
    DepthWritingEnabled=True,
    DrawMode=4,
    FragmentShader="""#version 330

uniform vec3 _lightDirection[4];
uniform mat3 _worldToCameraNormal;

uniform float div;
uniform vec4 col;
uniform float thickness;
uniform float ambient;

in  vec3 normal;
in vec3 camera_dir;
out vec4 fragment_color;

void main() {
  vec3 l = normalize(_lightDirection[0]);
  vec3 camNormal = _worldToCameraNormal * normal;
  float intensity = dot(l, normalize(camNormal.xyz));
  vec4 diffuse = col;

  vec3 ambientcol = vec3(ambient, ambient, ambient) * diffuse.rgb;
  
  float dif = round(abs(intensity) * div) / div;
  vec3 col = mix(ambientcol, diffuse.xyz, dif);
  
  float dotval = abs(dot(normal, camera_dir));
  dotval = step(thickness, dotval);
  
  col = col * dotval;
  
  fragment_color = vec4(col, diffuse.a);
}""",
    GLShader=(0, 2, 0),
    PreviewSortOrder=5,
    VertexShader="""#version 330

layout(location = 0) in vec3 _meshVertex;
layout(location = 1) in vec3 _meshNormal;

uniform mat4 _worldToClip;
uniform vec3 _cameraLocation;
out vec3 normal;
out vec3 camera_dir;

void main() {
  normal = _meshNormal;
  camera_dir = normalize(_meshVertex - _cameraLocation);
  gl_Position = _worldToClip * vec4(_meshVertex , 1.0);
}""",
    glLineWidth=3,
    glPointSize=8)  # -> Color, Depth
